% Simulink data dictionary BreakDownControll.sldd

VbAirRadiotube_CanTransFlt_null = Simulink.Signal(StorageClass="ExportedGlobal", DataType="boolean")
VbAirRadiotube_FlagOutputCircuitFlt_null = Simulink.Signal(StorageClass="ExportedGlobal", DataType="boolean")
VuAirRadiotube_OUT6_Ped_vu32_ms = Simulink.Signal(StorageClass="ExportedGlobal", DataType="uint32")
KbFLSwitch_flg = Simulink.Parameter(0, StorageClass="ExportedGlobal")
KbFRSwitch_flg = Simulink.Parameter(0, StorageClass="ExportedGlobal")
KbPINO_FLpct_flg = Simulink.Parameter(1, StorageClass="ExportedGlobal")
KbPINO_FLpct_num = Simulink.Parameter(0.6, StorageClass="ExportedGlobal")
KbRLSwitch_flg = Simulink.Parameter(0, StorageClass="ExportedGlobal")
KbRRSwitch_flg = Simulink.Parameter(0, StorageClass="ExportedGlobal")
KfCurFRFedOverRide_mA = Simulink.Parameter(0, StorageClass="ExportedGlobal")
KfFastCurrCon_push_ms = Simulink.Parameter(240, StorageClass="ExportedGlobal")
KfFastCurrCon_ramp_ms_one = Simulink.Parameter(60, StorageClass="ExportedGlobal")
KfFilterEn_value = Simulink.Parameter(1, StorageClass="ExportedGlobal")
KfFilterRst_value = Simulink.Parameter(0, StorageClass="ExportedGlobal")
KfSlowCurrCon_push_ms = Simulink.Parameter(100, StorageClass="ExportedGlobal")
KfSlowCurrCon_ramp_ms_second = Simulink.Parameter(300, StorageClass="ExportedGlobal")
VbAirRadiotube_ValveOpenFltFL_null = Simulink.Signal(StorageClass="ExportedGlobal", DataType="boolean")
VbAirRadiotube_ValveOpenFltFR_null = Simulink.Signal(StorageClass="ExportedGlobal", DataType="boolean")
VbAirRadiotube_ValveOpenFltRL_null = Simulink.Signal(StorageClass="ExportedGlobal", DataType="boolean")
VbAirRadiotube_ValveOpenFltRR_null = Simulink.Signal(StorageClass="ExportedGlobal", DataType="boolean")
VbAirRadiotube_ValveOverCurrFltFL_null = Simulink.Signal(StorageClass="ExportedGlobal", DataType="boolean")
VbAirRadiotube_ValveOverCurrFltFR_null = Simulink.Signal(StorageClass="ExportedGlobal", DataType="boolean")
VbAirRadiotube_ValveOverCurrFltRL_null = Simulink.Signal(StorageClass="ExportedGlobal", DataType="boolean")
VbAirRadiotube_ValveOverCurrFltRR_null = Simulink.Signal(StorageClass="ExportedGlobal", DataType="boolean")
VbAirRadiotube_ValveShortFltFL_null = Simulink.Signal(StorageClass="ExportedGlobal", DataType="boolean")
VbAirRadiotube_ValveShortFltFR_null = Simulink.Signal(StorageClass="ExportedGlobal", DataType="boolean")
VbAirRadiotube_ValveShortFltRL_null = Simulink.Signal(StorageClass="ExportedGlobal", DataType="boolean")
VbAirRadiotube_ValveShortFltRR_null = Simulink.Signal(StorageClass="ExportedGlobal", DataType="boolean")
VfAirRadiotube_Temp_C = Simulink.Signal(StorageClass="ExportedGlobal", DataType="single")
VuAirRadiotube_CUR1_J2EcuVol_vu32_mA = Simulink.Signal(StorageClass="ExportedGlobal", DataType="uint32")
VuAirRadiotube_CUR2_J2EcuVol_vu32_mA = Simulink.Signal(StorageClass="ExportedGlobal", DataType="uint32")
VuAirRadiotube_CUR3_J2EcuVol_vu32_mA = Simulink.Signal(StorageClass="ExportedGlobal", DataType="uint32")
VuAirRadiotube_CUR4_J2EcuVol_vu32_mA = Simulink.Signal(StorageClass="ExportedGlobal", DataType="uint32")
VuAirRadiotube_FailSafeSt_null = Simulink.Signal(StorageClass="ExportedGlobal", DataType="uint8")
VuAirRadiotube_Out_SprgCurFL_10mA = Simulink.Signal(StorageClass="ExportedGlobal", DataType="uint8")
VuAirRadiotube_Out_SprgCurFR_10mA = Simulink.Signal(StorageClass="ExportedGlobal", DataType="uint8")
VuAirRadiotube_Out_SprgCurRL_10mA = Simulink.Signal(StorageClass="ExportedGlobal", DataType="uint8")
VuAirRadiotube_Out_SprgCurRR_10mA = Simulink.Signal(StorageClass="ExportedGlobal", DataType="uint8")
VuAirRadiotube_OUT1_Duty_vu32_null = Simulink.Signal(StorageClass="ExportedGlobal", DataType="uint32")
VuAirRadiotube_OUT1_Ped_vu32_ms = Simulink.Signal(StorageClass="ExportedGlobal", DataType="uint32")
VuAirRadiotube_OUT2_Duty_vu32_null = Simulink.Signal(StorageClass="ExportedGlobal", DataType="uint32")
VuAirRadiotube_OUT2_Ped_vu32_ms = Simulink.Signal(StorageClass="ExportedGlobal", DataType="uint32")
VuAirRadiotube_OUT3_Duty_vu32_null = Simulink.Signal(StorageClass="ExportedGlobal", DataType="uint32")
VuAirRadiotube_OUT3_Ped_vu32_ms = Simulink.Signal(StorageClass="ExportedGlobal", DataType="uint32")
VuAirRadiotube_OUT4_Duty_vu32_null = Simulink.Signal(StorageClass="ExportedGlobal", DataType="uint32")
VuAirRadiotube_OUT4_Ped_vu32_ms = Simulink.Signal(StorageClass="ExportedGlobal", DataType="uint32")
VuAirRadiotube_OUT5_Duty_vu32_null = Simulink.Signal(StorageClass="ExportedGlobal", DataType="uint32")
VuAirRadiotube_OUT5_Ped_vu32_ms = Simulink.Signal(StorageClass="ExportedGlobal", DataType="uint32")
VuAirRadiotube_OUT7_Duty_vu32_null = Simulink.Signal(StorageClass="ExportedGlobal", DataType="uint32")
VuAirRadiotube_OUT7_Ped_vu32_ms = Simulink.Signal(StorageClass="ExportedGlobal", DataType="uint32")
VuAirRadiotube_OUT8_Duty_vu32_null = Simulink.Signal(StorageClass="ExportedGlobal", DataType="uint32")
VuAirRadiotube_OUT8_Ped_vu32_ms = Simulink.Signal(StorageClass="ExportedGlobal", DataType="uint32")
VuAirRadiotube_SprgCurReqFL_10mA = Simulink.Signal(StorageClass="ExportedGlobal", DataType="uint8")
VuAirRadiotube_SprgCurReqFR_10mA = Simulink.Signal(StorageClass="ExportedGlobal", DataType="uint8")
VuAirRadiotube_SprgCurReqRL_10mA = Simulink.Signal(StorageClass="ExportedGlobal", DataType="uint8")
VuAirRadiotube_SprgCurReqRR_10mA = Simulink.Signal(StorageClass="ExportedGlobal", DataType="uint8")
VuAirRadiotube_SprgFltFL_null = Simulink.Signal(StorageClass="ExportedGlobal", DataType="uint8")
VuAirRadiotube_SprgFltFR_null = Simulink.Signal(StorageClass="ExportedGlobal", DataType="uint8")
VuAirRadiotube_SprgFltRL_null = Simulink.Signal(StorageClass="ExportedGlobal", DataType="uint8")
VuAirRadiotube_SprgFltRR_null = Simulink.Signal(StorageClass="ExportedGlobal", DataType="uint8")
VuAirRadiotube_SprgStFL_null = Simulink.Signal(StorageClass="ExportedGlobal", DataType="uint8")
VuAirRadiotube_SprgStFR_null = Simulink.Signal(StorageClass="ExportedGlobal", DataType="uint8")
VuAirRadiotube_SprgStRL_null = Simulink.Signal(StorageClass="ExportedGlobal", DataType="uint8")
VuAirRadiotube_SprgStRR_null = Simulink.Signal(StorageClass="ExportedGlobal", DataType="uint8")
VuAirRadiotube_SprgValCorMod_null = Simulink.Signal(StorageClass="ExportedGlobal", DataType="uint8")
VuAirRadiotube_VBat2_VEcuVol_vu32_mA = Simulink.Signal(StorageClass="ExportedGlobal", DataType="uint32")
KfStReqFROverRide_value = Simulink.Parameter(0, StorageClass="ExportedGlobal", DataType="boolean")
KbStReqFRswitch_Flg = Simulink.Parameter(0, StorageClass="ExportedGlobal", DataType="boolean")
KfStReqFLOverRide_value = Simulink.Parameter(0, StorageClass="ExportedGlobal", DataType="boolean")
KbStReqFLSwitch_Flg = Simulink.Parameter(0, StorageClass="ExportedGlobal", DataType="boolean")
KfPINITempOverRide_value = Simulink.Parameter(0, StorageClass="ExportedGlobal", DataType="single")
KbPINITempSwitch_Flg = Simulink.Parameter(0, StorageClass="ExportedGlobal", DataType="single")
KfVbat2OverRide_mV = Simulink.Parameter(0, StorageClass="ExportedGlobal", DataType="uint32")
KbStReqRLSwitch_Flg = Simulink.Parameter(0, StorageClass="ExportedGlobal", DataType="boolean")
KfStReqRROverRide_Value = Simulink.Parameter(0, StorageClass="ExportedGlobal", DataType="boolean")
KbStReqRRSwitch_Flg = Simulink.Parameter(0, StorageClass="ExportedGlobal", DataType="boolean")
KfCanTransFltOverRide_Value = Simulink.Parameter(0, StorageClass="ExportedGlobal", DataType="boolean")
KbCanTransFltSwitch_Flg = Simulink.Parameter(0, StorageClass="ExportedGlobal", DataType="boolean")
KfShortFltFLOverRide_Value = Simulink.Parameter(0, StorageClass="ExportedGlobal", DataType="boolean")
KfOpenFltFLOverRide_Value = Simulink.Parameter(0, StorageClass="ExportedGlobal", DataType="boolean")
KbOpenFltFLSwitch_Flg = Simulink.Parameter(0, StorageClass="ExportedGlobal", DataType="boolean")
KfOverCurrFltFLOverRide_Value = Simulink.Parameter(0, StorageClass="ExportedGlobal", DataType="boolean")
KbOverCurrFltFLSwitch_Flg = Simulink.Parameter(0, StorageClass="ExportedGlobal", DataType="boolean")
KfShortFltFROverRide_Value = Simulink.Parameter(0, StorageClass="ExportedGlobal", DataType="boolean")
KbShortFltFRSwitch_Flg = Simulink.Parameter(0, StorageClass="ExportedGlobal", DataType="boolean")
KfOpenFltFROverRide_Value = Simulink.Parameter(0, StorageClass="ExportedGlobal", DataType="boolean")
KbOpenFltFRSwitch_Flg = Simulink.Parameter(0, StorageClass="ExportedGlobal", DataType="boolean")
KfOverCurrFltFROverRide_Value = Simulink.Parameter(0, StorageClass="ExportedGlobal", DataType="boolean")
KbOverCurrFltFRSwitch_Flg = Simulink.Parameter(0, StorageClass="ExportedGlobal", DataType="boolean")
KfShortFltRLOverRide_Value = Simulink.Parameter(0, StorageClass="ExportedGlobal", DataType="boolean")
KbShortFltRLSwitch_Flg = Simulink.Parameter(0, StorageClass="ExportedGlobal", DataType="boolean")
KfOpenFltRLOverRide_Value = Simulink.Parameter(0, StorageClass="ExportedGlobal", DataType="boolean")
KbOpenFltRLSwitch_Flg = Simulink.Parameter(0, StorageClass="ExportedGlobal", DataType="boolean")
KfOverCurrFltRLOverRide_Value = Simulink.Parameter(0, StorageClass="ExportedGlobal", DataType="boolean")
KbOverCurrFltRLSwitch_Flg = Simulink.Parameter(0, StorageClass="ExportedGlobal", DataType="boolean")
KfShortFltRROverRide_Value = Simulink.Parameter(0, StorageClass="ExportedGlobal", DataType="boolean")
KbShortFltRRSwitch_Flg = Simulink.Parameter(0, StorageClass="ExportedGlobal", DataType="boolean")
KfOpenFltRROverRide_Value = Simulink.Parameter(0, StorageClass="ExportedGlobal", DataType="boolean")
KbOpenFltRRSwitch_Flg = Simulink.Parameter(0, StorageClass="ExportedGlobal", DataType="boolean")
KfOverCurrFltRROverRide_Value = Simulink.Parameter(0, StorageClass="ExportedGlobal", DataType="boolean")
KbOverCurrFltRRSwitch_Flg = Simulink.Parameter(0, StorageClass="ExportedGlobal", DataType="boolean")
KfCurFLFedOverRide_mA = Simulink.Parameter(0, StorageClass="ExportedGlobal", DataType="uint32")
KbFRFedSwitch_flg = Simulink.Parameter(0, StorageClass="ExportedGlobal", DataType="uint32")
KfCurRLFedOverRide_mA = Simulink.Parameter(0, StorageClass="ExportedGlobal", DataType="uint32")
KbRLFedSwitch_flg = Simulink.Parameter(0, StorageClass="ExportedGlobal", DataType="uint32")
KfCurRRFedOverRide_mA = Simulink.Parameter(0, StorageClass="ExportedGlobal", DataType="uint32")
KbRRFedSwitch_flg = Simulink.Parameter(0, StorageClass="ExportedGlobal", DataType="uint32")
KfSprgValCorModOverRide_Value = Simulink.Parameter(0, StorageClass="ExportedGlobal", DataType="uint8")
KbSprgValCorModSwitch_flg = Simulink.Parameter(0, StorageClass="ExportedGlobal", DataType="uint8")
KfCurReqFLOverRide_10mA = Simulink.Parameter(0, StorageClass="ExportedGlobal", DataType="uint8")
KbCurReqFLSwitch_flg = Simulink.Parameter(0, StorageClass="ExportedGlobal", DataType="uint8")
KfCurReqFROverRide_10mA = Simulink.Parameter(0, StorageClass="ExportedGlobal", DataType="uint8")
KbCurReqFRSwitch_flg = Simulink.Parameter(0, StorageClass="ExportedGlobal", DataType="uint8")
KfCurReqRLOverRide_10mA = Simulink.Parameter(0, StorageClass="ExportedGlobal", DataType="uint8")
KbCurReqRLSwitch_flg = Simulink.Parameter(0, StorageClass="ExportedGlobal", DataType="uint8")
KfCurReqRROverRide_10mA = Simulink.Parameter(0, StorageClass="ExportedGlobal", DataType="boolean")
KbFLFedSwitch_flg = Simulink.Parameter(0, StorageClass="ExportedGlobal", DataType="uint32")
KbVbat2Switch_flg = Simulink.Parameter(0, StorageClass="ExportedGlobal", DataType="uint32")
KfStReqRLOverRide_Value = Simulink.Parameter(0, StorageClass="ExportedGlobal", DataType="boolean")
KfTriggerTimer_ms = Simulink.Parameter(200, StorageClass="ExportedGlobal")
KfUpperTempThreshold_value = Simulink.Parameter(80, StorageClass="ExportedGlobal", DataType="single")
KfLowerTempthreshold_value = Simulink.Parameter(-40, StorageClass="ExportedGlobal", DataType="single")
KfTriggerTimerV_ms = Simulink.Parameter(200, StorageClass="ExportedGlobal", DataType="single")
KfLowerVThreshold_mV = Simulink.Parameter(9000, StorageClass="ExportedGlobal", DataType="uint32")
KfVWork_mV = Simulink.Parameter(9000, StorageClass="ExportedGlobal", DataType="uint32")
VuAirRadiotube_OUT6_Duty_vu32_ = Simulink.Signal(StorageClass="ExportedGlobal", DataType="uint32")
VuAirRadiotube_OUT6_Duty_vu32_null = Simulink.Signal(StorageClass="ExportedGlobal")
KfFilterFactor_value = Simulink.Parameter(0.15, StorageClass="ExportedGlobal", DataType="single")
VuAirRadiotube_Vat2_mA = Simulink.Signal(StorageClass="ExportedGlobal")
KfUpperVThreshold_mV = Simulink.Parameter(16000, StorageClass="ExportedGlobal", DataType="uint32")
KfPWM_OnDebTime_ms = Simulink.Parameter(200, StorageClass="ExportedGlobal")
KfPWM_PeriodTime_ms = Simulink.Parameter(600, StorageClass="ExportedGlobal")
VbAirRadiotube_LRevsLghtDrvSts_null = Simulink.Signal(StorageClass="ExportedGlobal")
VbAirRadiotube_SprgStReqFL_null = Simulink.Signal(StorageClass="ExportedGlobal")
VbAirRadiotube_SprgStReqFR_null = Simulink.Signal(StorageClass="ExportedGlobal")
VbAirRadiotube_SprgStReqRL_null = Simulink.Signal(StorageClass="ExportedGlobal")
VbAirRadiotube_SprgStReqRR_null = Simulink.Signal(StorageClass="ExportedGlobal")
VbAirRadiotube_FlagOutputVFlt_null = Simulink.Signal(StorageClass="ExportedGlobal", DataType="boolean")
VbAirRadiotube_FlagOutputVLowFlt_null = Simulink.Signal(StorageClass="ExportedGlobal", DataType="boolean")
VbAirRadiotube_FlagOutputTempFlt_null = Simulink.Signal(StorageClass="ExportedGlobal", DataType="boolean")
KuFailSafeOverRide_null = Simulink.Parameter(0, StorageClass="ExportedGlobal", DataType="uint8")
KuFailSafeSwitch_null = Simulink.Parameter(0, StorageClass="ExportedGlobal", DataType="uint8")
VuAirRadiotube_FailSafe_null = Simulink.Signal(StorageClass="ExportedGlobal", DataType="uint8")
KbPINO_FLpct1_num = Simulink.Parameter(0, StorageClass="ExportedGlobal")
KbPINO_FLpct1_flg = Simulink.Parameter(0, StorageClass="ExportedGlobal")
KbPINO_FLpct2_num = Simulink.Parameter(0, StorageClass="ExportedGlobal")
KbPINO_FLpct2_flg = Simulink.Parameter(0, StorageClass="ExportedGlobal")
KbPINO_FRpct1_num = Simulink.Parameter(0, StorageClass="ExportedGlobal")
KbPINO_FRpct1_flg = Simulink.Parameter(0, StorageClass="ExportedGlobal")
KbPINO_FRpct2_num = Simulink.Parameter(0, StorageClass="ExportedGlobal")
KbPINO_FRpct2_flg = Simulink.Parameter(0, StorageClass="ExportedGlobal")
KbPINO_FRpct_num = Simulink.Parameter(0, StorageClass="ExportedGlobal")
KbPINO_FRpct_flg = Simulink.Parameter(0, StorageClass="ExportedGlobal")
KbPINO_RLpct1_num = Simulink.Parameter(0, StorageClass="ExportedGlobal")
KbPINO_RLpct1_flg = Simulink.Parameter(0, StorageClass="ExportedGlobal")
KbPINO_RLpct2_num = Simulink.Parameter(0, StorageClass="ExportedGlobal")
KbPINO_RLpct2_flg = Simulink.Parameter(0, StorageClass="ExportedGlobal")
KbPINO_RLpct_num = Simulink.Parameter(0, StorageClass="ExportedGlobal")
KbPINO_RLpct_flg = Simulink.Parameter(0, StorageClass="ExportedGlobal")
KbPINO_RRpct1_num = Simulink.Parameter(0, StorageClass="ExportedGlobal")
KbPINO_RRpct1_flg = Simulink.Parameter(0, StorageClass="ExportedGlobal")
KbPINO_RRpct2_num = Simulink.Parameter(0, StorageClass="ExportedGlobal")
KbPINO_RRpct2_flg = Simulink.Parameter(0, StorageClass="ExportedGlobal")
KbPINO_RRpct_num = Simulink.Parameter(0, StorageClass="ExportedGlobal")
KbPINO_RRpct_flg = Simulink.Parameter(0, StorageClass="ExportedGlobal")
KbFLSwitch2_flg = Simulink.Parameter(0, StorageClass="ExportedGlobal")
KbFRSwitch2_flg = Simulink.Parameter(0, StorageClass="ExportedGlobal")
KbRLSwitch2_flg = Simulink.Parameter(0, StorageClass="ExportedGlobal")
KbRRSwitch2_flg = Simulink.Parameter(0, StorageClass="ExportedGlobal")
out_Cur1 = Simulink.Signal(StorageClass="ExportedGlobal")
out_Cur2 = Simulink.Signal(StorageClass="ExportedGlobal")
out_Cur3 = Simulink.Signal(StorageClass="ExportedGlobal")
out_Cur4 = Simulink.Signal(StorageClass="ExportedGlobal")
KbCurReqRRSwitch_flg = Simulink.Parameter(0, StorageClass="ExportedGlobal")
KfPINO_damprCur_FLPed_null = Simulink.Parameter(50, StorageClass="ExportedGlobal")
KbShortFltFLSwitch_Flg = Simulink.Parameter(0, StorageClass="ExportedGlobal", DataType="boolean")
VuAirRadiotube_FailSafeSt_nul1l = Simulink.Signal(StorageClass="ExportedGlobal")
KfBaseTimerV_ms = Simulink.Parameter(1, StorageClass="ExportedGlobal", DataType="single")
KfBaseTimer_ms = Simulink.Parameter(1, StorageClass="ExportedGlobal")
KfPWM_BaseTime_ms = Simulink.Parameter(1, StorageClass="ExportedGlobal")
KfPINO_damprCur_FLkp_null = Simulink.Parameter(0.01, StorageClass="ExportedGlobal")
Param = Simulink.Parameter(0.08, StorageClass="ExportedGlobal")
KfPINO_damprCur_FLki1_null = Simulink.Parameter(100, StorageClass="ExportedGlobal")
KfFLOverRide2_10mA = Simulink.Parameter(0, StorageClass="ExportedGlobal", DataType="uint8")
KfFLOverRide_10mA = Simulink.Parameter(60, StorageClass="ExportedGlobal", DataType="uint8")
KfFROverRide_10mA = Simulink.Parameter(0, StorageClass="ExportedGlobal", DataType="uint8")
KfFROverRide2_10mA = Simulink.Parameter(0, StorageClass="ExportedGlobal", DataType="uint8")
KfRLOverRide_10mA = Simulink.Parameter(0, StorageClass="ExportedGlobal", DataType="uint8")
KfRLOverRide2_10mA = Simulink.Parameter(0, StorageClass="ExportedGlobal", DataType="uint8")
KfRROverRide_10mA = Simulink.Parameter(0, StorageClass="ExportedGlobal", DataType="uint8")
KfRROverRide2_10mA = Simulink.Parameter(0, StorageClass="ExportedGlobal", DataType="uint8")
KfPINO_damprCur_FLkp1_null = Simulink.Parameter(0.01, StorageClass="ExportedGlobal")
KfPINO_damprCur_FLki_null = Simulink.Parameter(0.1, StorageClass="ExportedGlobal")
S1 = Simulink.Signal(StorageClass="ExportedGlobal")
B = Simulink.Parameter(1, StorageClass="ExportedGlobal")
S2 = Simulink.Signal(StorageClass="ExportedGlobal")
S3 = Simulink.Signal(StorageClass="ExportedGlobal")
VuOverThreshold_boolean = Simulink.Parameter(2, StorageClass="ExportedGlobal", DataType="uint8")
VuState_Threshold_mA = Simulink.Parameter(80, StorageClass="ExportedGlobal", DataType="uint8")
KfVINO_Resistant_Ohm = Simulink.Parameter(3.55, StorageClass="ExportedGlobal")